# Grasshopper definition rammeprogram.gh (Grasshopper 0.9.76)
# plug-ins: Python Interpreter

crv = Curve([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])

explode = Explode(Curve=crv, Recursive=True)  # -> Segments, Vertices
panel = Panel("""0,1,0
1,2,0
2,3,0
3,4,0
4,5,0
5,6,0
6,7,0
7,8,0
8,9,0
9,10,0
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""")
panel_2 = Panel("""0,20
10,20
20,20
30,20
40,20
50,20
60,20
70,20
80,20
90,20
100,20
110,20
120,20
0,0
10,5.23
20,9.51
30,12.84
40,15.21
50,16.64
60,17.12
70,16.64
80,15.21
90,12.84
100,9.51
110,5.23
120,0""")
eval = EvaluateCurve(Curve=reparameterize(explode.Segments), Parameter=0.5)  # -> Point, Tangent, Angle
sort_pt = SortPoints(Points=flatten(eval.Point))  # -> Points, Indices
tstat = TreeStatistics(Tree=eval.Point)  # -> Paths, Length, Count
pt = Point(panel)
pt_2 = Point(panel_2)
pdecon = Deconstruct(Point=panel)  # -> XComponent, YComponent, ZComponent
panel_3 = Panel("""     14 11
14 2 0
                      14 6 0
                      26 1 0
                      26 2 0
                      1 2 0
                      7 1 0
                      13 2 0""")
item = ListItem(List=tstat.Paths, Index=sort_pt.Indices, Wrap=True)
int = Integer(pdecon.XComponent)
int_2 = Integer(pdecon.YComponent)
lng = ListLength(List=pt_2)
xy = XYPlane(Origin=pt_2)
branch = TreeBranch(Tree=explode.Segments, Path=item, MaintainPaths=False)
bbox = BoundingBox(Content=pt_2, Plane=PlaneXY(0, 0, 0), UnionBox=True)  # -> Box, Box_2
item_2 = ListItem(List=pt_2, Index=int, Wrap=True)
item_3 = ListItem(List=pt_2, Index=int_2, Wrap=True)
python = PythonScript(topolist=pt, nodes=pt_2)  # -> out, elements; inputs topolist: list, nodes: list
# ---------- python: Python ----------
import rhinoscriptsyntax as rs
import scriptcontext
import Rhino
scriptcontext.doc = ghdoc
startpoint=[]
endpoint=[]
eleProp=[]
elements=[]

for topo in topolist:
    indices=str(rs.PointCoordinates(topo)).split(",")
    stpt=nodes[int(indices[0])]
    enpt=nodes[int(indices[1])]
    startpoint.append(stpt)
    endpoint.append(enpt)
    elements.append(rs.AddLine(stpt,enpt))
    #eleProp.append(nodes[indices[2]])
# ---------- end python ----------
explode_2 = Explode(Curve=branch, Recursive=True)  # -> Segments, Vertices
eval_2 = EvaluateCurve(Curve=reparameterize(flatten(explode_2.Segments)), Parameter=0.5)  # -> Point, Tangent, Angle
series = Series(Start=0, Step=1, Count=lng)
crv_2 = Curve(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)
crv_3 = Curve(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)
crv_4 = Curve(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)
area = Area(Geometry=bbox.Box)  # -> Area, Centroid
series_2 = Series(Start=0, Step=1, Count=10)
sort_pt_2 = SortPoints(Points=flatten(explode_2.Vertices))  # -> Points, Indices
ln = Line(StartPoint=item_2, EndPoint=item_3)
merge = Merge(Data1=crv_2, Data2=crv_3, Data3=crv_4)
panel_4 = Panel("""14,1
14,2
14,3
26,1
26,2
1,2
7,1
13,2""")
int_3 = Integer(series)
division = Division(A=area.Area, B=1000)
points = PointList(Points=eval_2.Point)
pdecon_2 = Deconstruct(Point=sort_pt_2.Points)  # -> XComponent, YComponent, ZComponent
scale = Scale(Geometry=merge, Center=Point(0, 0, 0), Factor=division)  # -> Geometry, Transform
pt_3 = ConstructPoint(XCoordinate=pdecon_2.XComponent, YCoordinate=pdecon_2.YComponent, ZCoordinate=0)
tag = TextTag3D(Location=pt_2, Text=int_3, Size=division, Justification=7)
lng_2 = ListLength(List=pt_3)
panel_5 = Panel(sort_pt_2.Points)
cullpt = CullDuplicates(Points=pt_3, Tolerance=Slider(0.001, range=0..0.001), CullMode=3)  # -> Points, Indices, Valence
series_3 = Series(Start=0, Step=1, Count=lng_2)
cull_i = CullIndex(List=series_3, Indices=cullpt.Indices, Wrap=True)
item_4 = ListItem(List=cull_i, Index=sort_pt_2.Indices, Wrap=True)
partition = PartitionList(List=item_4, Size=2)
points_2 = PointList(Points=cullpt.Points)
panel_6 = Panel(partition)
nodes = Panel(pt_3)
